# Dynamo graph Assign Depth Class.dyn (Dynamo 2.3.0.5885)

string = StringInput("W-Wide Flange")
byName = Family.ByName(name=string)
types = Family.Types(family=byName)
string_2 = StringInput("Depth Class")
name = FamilyType.Name(familyType=types)
string_3 = StringInput("X")
string_4 = StringInput("x")
split = String.Split(str=name, separator0=string_3, separator1=string_4)
transpose = List.Transpose(lists=split)
code_block = CodeBlock { 0; }
getItemAtIndex = List.GetItemAtIndex(list=transpose, index=code_block)
setParameterByName = Element.SetParameterByName(element=types, parameterName=string_2, value=getItemAtIndex)
watch = Watch(getItemAtIndex)
string_5 = StringInput("W Shapes-Column")
