# Dynamo graph CreateSharedParameters.dyn (Dynamo 2.3.0.5885)
# packages: archi-lab.net 2022.212.3222

string = StringInput("Brace Force")
string_2 = StringInput("Forces")
parameter_types = ParameterTypeUi("Force")
parameter_groups = ParameterGroupUi("PG_STRUCTURAL")
instance = BoolSelector(true)
categories = Categories("OST_StructuralFraming")
createSharedParameter = Parameter.CreateSharedParameter(parameterName=string, groupName=string_2, type=parameter_types, group=parameter_groups, instance=instance, categoryList=categories)
string_3 = StringInput("Beam Start Reaction")
string_4 = StringInput("Beam End Reaction")
string_5 = StringInput("Beam End Pass Thru Force")
string_6 = StringInput("Beam Start Pass Thru Force")
string_7 = StringInput("Beam End Moment")
string_8 = StringInput("Beam Start Torsion")
string_9 = StringInput("Beam End Torsion")
string_10 = StringInput("Beam Start Moment")
string_11 = StringInput("Moments")
parameter_types_2 = ParameterTypeUi("Force")
parameter_groups_2 = ParameterGroupUi("PG_STRUCTURAL")
instance_2 = BoolSelector(true)
categories_2 = Categories("OST_StructuralFraming")
createSharedParameter_2 = Parameter.CreateSharedParameter(parameterName=string_10, groupName=string_11, type=parameter_types_2, group=parameter_groups_2, instance=instance_2, categoryList=categories_2)
