# Dynamo graph UpdateBeamForces.dyn (Dynamo 2.10.1.3976)
# packages: spring nodes 204.1.0

# group: Inputs
minimum_shear_kips = DoubleInput(10)  # graph input
update_all_elements = BoolSelector(false)  # graph input
scale_factor = DoubleInput(1)  # graph input
rounding_threshold = DoubleInput(100)  # graph input
rounding_interval_for_values = DoubleInput(5)  # "Rounding Interval (for Values Above threshold)"; graph input
rounding_interval_for_values_2 = DoubleInput(0.1)  # "Rounding Interval (for Values Below threshold)"; graph input
increase_only = BoolSelector(false)  # graph input

# group: Collect all framing elements
categories = Categories("OST_StructuralFraming")
all_elements_of_category = ElementsOfCategory(Category=categories)
boolean = BoolSelector(true)
ꟿ_collect_currentselection = Custom[ꟿ Collect.CurrentSelection](refresh=boolean)  # package spring nodes; Gets the currently selected elements. Connect a boolean switch to refresh the selection.
scopeIf = ScopedIf(test=update_all_elements, true=all_elements_of_category, false=ꟿ_collect_currentselection)

# group: Filter out brace elements
string = StringInput("Structural Usage")
# note: Filter out of list if Structural Usage = Other
getParameterValueByName = Element.GetParameterValueByName(element=scopeIf, parameterName=string)
n6_other = DoubleInput(6)  # "6=Other"
eq = getParameterValueByName == n6_other
filterByBoolMask = List.FilterByBoolMask(list=scopeIf, mask=eq)

# group: Update Parameters
updateBeamStartReaction = Custom[UpdateBeamStartReaction](minShear=minimum_shear_kips, elements=filterByBoolMask.out, scaleFactor=scale_factor, roundingThreshold=rounding_threshold, roundingIntervalLarge=rounding_interval_for_values, roundingIntervalSmall=rounding_interval_for_values_2, increaseOnly=increase_only)
updateBeamEndReaction = Custom[UpdateBeamEndReaction](elements=filterByBoolMask.out, scaleFactor=scale_factor, roundingThreshold=rounding_threshold, roundingIntervalLarge=rounding_interval_for_values, roundingIntervalSmall=rounding_interval_for_values_2, minShear=minimum_shear_kips, increaseOnly=increase_only)
updateBeamStartPassThruForce = Custom[UpdateBeamStartPassThruForce](elements=filterByBoolMask.out, scaleFactor=scale_factor, roundingThreshold=rounding_threshold, roundingIntervalLarge=rounding_interval_for_values, roundingIntervalSmall=rounding_interval_for_values_2, increaseOnly=increase_only)
updateBeamEndPassThruForce = Custom[UpdateBeamEndPassThruForce](elements=filterByBoolMask.out, scaleFactor=scale_factor, roundingThreshold=rounding_threshold, roundingIntervalLarge=rounding_interval_for_values, roundingIntervalSmall=rounding_interval_for_values_2, increaseOnly=increase_only)
updateBeamStartMoment = Custom[UpdateBeamStartMoment](elements=filterByBoolMask.out, scaleFactor=scale_factor, roundingThreshold=rounding_threshold, roundingIntervalLarge=rounding_interval_for_values, roundingIntervalSmall=rounding_interval_for_values_2, increaseOnly=increase_only)
updateBeamEndMoment = Custom[UpdateBeamEndMoment](elements=filterByBoolMask.out, scaleFactor=scale_factor, roundingThreshold=rounding_threshold, roundingIntervalLarge=rounding_interval_for_values, roundingIntervalSmall=rounding_interval_for_values_2, increaseOnly=increase_only)

# group: Outputs
elements_updated = Watch(filterByBoolMask.out)
