# Dynamo custom node UpdateBeamStartMoment.dyf (Dynamo 2.10.1.3976)
# category: UpdateForces

elements = Input(elements: Revit.Elements.Element)

# group: Collect TSD Parameters from Elements
string = StringInput("Result_StartMomentMax")
getParameterValueByName = Element.GetParameterValueByName(element=elements, parameterName=string, lacing=CrossProduct)
length = String.Length(str=getParameterValueByName)
number = DoubleInput(0)
eq = Equals(x=length, y=number)
number_2 = DoubleInput(0)
if_ = If(test=eq, true=number_2, false=getParameterValueByName)
abs = Math.Abs(number=if_)
string_2 = StringInput("Result_StartMomentMaxNeg")
getParameterValueByName_2 = Element.GetParameterValueByName(element=elements, parameterName=string_2, lacing=CrossProduct)
length_2 = String.Length(str=getParameterValueByName_2)
eq_2 = Equals(x=length_2, y=number)
if_2 = If(test=eq_2, true=number_2, false=getParameterValueByName_2)
abs_2 = Math.Abs(number=if_2)
max = Math.Max(value1=abs, value2=abs_2)

# group: Scale Forces
scaleFactor = Input(scaleFactor: var)
mul = max * scaleFactor

# group: Round Forces
abs_3 = Math.Abs(number=mul)
roundingThreshold = Input(roundingThreshold: var)
gt = abs_3 > roundingThreshold
roundingIntervalLarge = Input(roundingIntervalLarge: var)
roundingIntervalSmall = Input(roundingIntervalSmall: var)
if_3 = If(test=gt, true=roundingIntervalLarge, false=roundingIntervalSmall)
div = mul / if_3

watch = Watch(div)

# group (continued): Round Forces
ceiling = Math.Ceiling(number=watch)

watch_2 = Watch(ceiling)

# group (continued): Round Forces
mul_2 = watch_2 * if_3

# group: Collect existing values from elements
string_3 = StringInput("Beam Start Moment")
getParameterValueByName_3 = Element.GetParameterValueByName(element=elements, parameterName=string_3, lacing=CrossProduct)

# group: Compare to Existing values
increaseOnly = Input(increaseOnly: var[]..[])
abs_4 = Math.Abs(number=mul_2)
abs_5 = Math.Abs(number=getParameterValueByName_3)
gt_2 = abs_4 > abs_5
if_4 = If(test=gt_2, true=mul_2, false=getParameterValueByName_3)
scopeIf = ScopedIf(test=increaseOnly, true=if_4, false=mul_2)

# group: Update element parameters
string_4 = StringInput("Beam Start Moment")
setParameterByName = Element.SetParameterByName(element=elements, parameterName=string_4, value=scopeIf)

Element = Output(setParameterByName)
