# Dynamo custom node UpdateColumnAxialMax.dyf (Dynamo 2.6.1.8786)
# category: UpdateForces

elements = Input(elements: Revit.Elements.Element)

# group: Collect TSD parameter values from elements
string = StringInput("Result_ColVShearMax")
getParameterValueByName = Element.GetParameterValueByName(element=elements, parameterName=string, lacing=CrossProduct)

# group: Scale Forces
scaleFactor = Input(scaleFactor: var)
mul = getParameterValueByName * scaleFactor

# group: Round Forces
abs = Math.Abs(number=mul)
roundingThreshold = Input(roundingThreshold: var)
gt = abs > roundingThreshold
roundingIntervalLarge = Input(roundingIntervalLarge: var)
roundingIntervalSmall = Input(roundingIntervalSmall: var)
if_ = If(test=gt, true=roundingIntervalLarge, false=roundingIntervalSmall)
div = mul / if_
ceiling = Math.Ceiling(number=div)
mul_2 = ceiling * if_

# group: Flip Signs
number = DoubleInput(-1)
# note: (-) : Compression
# (+): Tension
mul_3 = number * mul_2

# group: Collect existing values from elements
string_2 = StringInput("Column Axial Max")
getParameterValueByName_2 = Element.GetParameterValueByName(element=elements, parameterName=string_2, lacing=CrossProduct)

# group: Compare to Existing values
increaseOnly = Input(increaseOnly: var[]..[])
abs_2 = Math.Abs(number=mul_3)
abs_3 = Math.Abs(number=getParameterValueByName_2)
gt_2 = abs_2 > abs_3
if_2 = If(test=gt_2, true=mul_3, false=getParameterValueByName_2)
scopeIf = ScopedIf(test=increaseOnly, true=if_2, false=mul_3)

# group: Update element parameters
string_3 = StringInput("Column Axial Max")
setParameterByName = Element.SetParameterByName(element=elements, parameterName=string_3, value=scopeIf)

Element = Output(setParameterByName)
