# Dynamo graph UpdateColumnForces.dyn (Dynamo 2.10.1.3976)
# packages: spring nodes 204.1.0

# group: Inputs
update_all_elements = BoolSelector(false)  # graph input
scale_factor = DoubleInput(1)  # graph input
rounding_threshold = DoubleInput(1000)  # graph input
rounding_interval_for_values = DoubleInput(100)  # "Rounding Interval (for Values above threshold)"; graph input
rounding_interval_for_values_2 = DoubleInput(10)  # "Rounding Interval (for Values below threshold)"; graph input
increase_only = BoolSelector(false)  # graph input

# group: Collect all elements
categories = Categories("OST_StructuralColumns")
all_elements_of_category = ElementsOfCategory(Category=categories)
boolean = BoolSelector(true)
ꟿ_collect_currentselection = Custom[ꟿ Collect.CurrentSelection](refresh=boolean)  # package spring nodes; Gets the currently selected elements. Connect a boolean switch to refresh the selection.
scopeIf = ScopedIf(test=update_all_elements, true=all_elements_of_category, false=ꟿ_collect_currentselection)

# group: Update Parameters
updateColumnAxialMax = Custom[UpdateColumnAxialMax](elements=scopeIf, scaleFactor=scale_factor, roundingThreshold=rounding_threshold, roundingIntervalLarge=rounding_interval_for_values, roundingIntervalSmall=rounding_interval_for_values_2, increaseOnly=increase_only)
updateColumnAxialMin = Custom[UpdateColumnAxialMin](elements=scopeIf, scaleFactor=scale_factor, roundingThreshold=rounding_threshold, roundingIntervalLarge=rounding_interval_for_values, roundingIntervalSmall=rounding_interval_for_values_2, increaseOnly=increase_only)
updateColumnShearMajor = Custom[UpdateColumnShearMajor](elements=scopeIf, scaleFactor=scale_factor, roundingThreshold=rounding_threshold, roundingIntervalLarge=rounding_interval_for_values, roundingIntervalSmall=rounding_interval_for_values_2, increaseOnly=increase_only)
updateColumnShearMinor = Custom[UpdateColumnShearMinor](elements=scopeIf, scaleFactor=scale_factor, roundingThreshold=rounding_threshold, roundingIntervalLarge=rounding_interval_for_values, roundingIntervalSmall=rounding_interval_for_values_2, increaseOnly=increase_only)
updateColumnMomentMajor = Custom[UpdateColumnMomentMajor](elements=scopeIf, scaleFactor=scale_factor, roundingThreshold=rounding_threshold, roundingIntervalLarge=rounding_interval_for_values, roundingIntervalSmall=rounding_interval_for_values_2, increaseOnly=increase_only)
updateColumnMomentMinor = Custom[UpdateColumnMomentMinor](elements=scopeIf, scaleFactor=scale_factor, roundingThreshold=rounding_threshold, roundingIntervalLarge=rounding_interval_for_values, roundingIntervalSmall=rounding_interval_for_values_2, increaseOnly=increase_only)

# group: Outputs
elements_updated = Watch(scopeIf)
